# Grasshopper definition Massing Design Calculator 0.6.2 (Mixed Used).gh (Grasshopper 1.0.7)
# plug-ins: dotbimGH, TT Toolbox

land_value = DigitScroller(Scroller_Digits=12, Scroller_Prefix="Land Value", Scroller_Radix=11, Scroller_Value=1300000)
hard_vs_soft_coef = DigitScroller(Scroller_Digits=12, Scroller_Prefix="Hard vs Soft Coef", Scroller_Radix=11, Scroller_Value=75)
net_coefficient = DigitScroller(Scroller_Digits=12, Scroller_Prefix="Net Coefficient", Scroller_Radix=11, Scroller_Value=85)
cap_rate = DigitScroller(Scroller_Digits=12, Scroller_Prefix="Cap Rate", Scroller_Radix=11, Scroller_Value=5)

# ---- group: Very Low Income
vli = Brep()

# ---- group: Moderate Income
moderate = Brep()

# ----
market_rate = Brep()
retail = Brep()
community_spaces = Brep()
code_required_parking = Brep()
visitor_parking = Brep()

# ---- group: Extremly Low Income
eli = Brep(graft([<brep referenced from the Rhino model> x2]))

# ----
typical_floor_height = DigitScroller(Scroller_Digits=12, Scroller_Prefix="Typical Floor Height", Scroller_Radix=11, Scroller_Value=10)

# ---- group: Extremly Low Income
eli_2 = Brep(graft(<brep referenced from the Rhino model>))

# ----
typical_floor_height_2 = DigitScroller(Scroller_Digits=12, Scroller_Prefix="Typical Floor Height", Scroller_Radix=11, Scroller_Value=10)

# ---- group: Extremly Low Income
eli_3 = Brep(graft(<brep referenced from the Rhino model>))

# ----
typical_floor_height_3 = DigitScroller(Scroller_Digits=12, Scroller_Prefix="Typical Floor Height", Scroller_Radix=11, Scroller_Value=8)
omit_last_floor_slab = BooleanToggle(False)
omit_last_floor_slab_2 = BooleanToggle(False)
omit_last_floor_slab_3 = BooleanToggle(False)

cluster = Cluster(massing=eli, typical_floor_height=typical_floor_height, bool=omit_last_floor_slab)  # -> facade_attributes_2, points_facade_attributes, walls_2, roof, floors_2, floor_plate_curves, areas, length_tree
unit_density = DigitScroller(Scroller_Digits=12, Scroller_Prefix="Unit Density", Scroller_Radix=11, Scroller_Value=200)
construction_cost_per_sf = DigitScroller(Scroller_Digits=12, Scroller_Prefix="Construction Cost Per SF", Scroller_Radix=11, Scroller_Value=375)
sale_price_per_sf = DigitScroller(Scroller_Digits=12, Scroller_Prefix="Sale Price Per SF", Scroller_Radix=11, Scroller_Value=1075)
rent_per_sf = DigitScroller(Scroller_Digits=12, Scroller_Prefix="Rent Per SF", Scroller_Radix=10, Scroller_Value=3.24)
python = GhPythonScript(
    areas=cluster.areas,
    unit_density=unit_density,
    cpsf=construction_cost_per_sf,
    ppsf=sale_price_per_sf,
    rpsf=rent_per_sf,
    cap_rate=cap_rate,
    net_coef=net_coefficient,
    land_value=land_value,
    hard_soft_coef=hard_vs_soft_coef)  # -> values, dic_keys, dic_values; inputs areas: list
# ---------- python: Python ----------
__author__ = "ilouh"
__version__ = "2023.02.21"

import rhinoscriptsyntax as rs
import Grasshopper as gh
import Rhino.Geometry as rg
import ghpythonlib.components as comps
import math

#sum a list of numbers
def sum(numbers):
    total = 0
    for n in numbers:
        total += n
    return total

total_area = sum(areas)
units = math.floor(total_area/unit_density)

#Functions
def format_to_dollar_price(value):
    if isinstance(value, (int, float)):
        formatted_value = "${:,.2f}".format(value)
    elif isinstance(value, str):
        # Remove any non-numeric characters
        value = ''.join(filter(str.isdigit, value))
        if value:
            formatted_value = "${:,.2f}".format(float(value)/100)
        else:
            formatted_value = "$0.00"
    else:
        raise TypeError("Unsupported value type. Only int, float, and str are supported.")
    
    return formatted_value

def float_to_percentage(number):
    percentage = number * 100
    formatted_percentage = "{:.2f}%".format(percentage)
    return formatted_percentage

def format_to_sf_area(value):
    if isinstance(value, (int, float)):
        formatted_value = "{:,.2f} SF".format(value)
    else:
        raise TypeError("Unsupported value type. Only int and float are supported.")
    
    return formatted_value

#_______________________________________________________________________________________
# Calculations
average_unit_size = total_area / units  # Average size of each unit in square feet
average_rent = float(rpsf) * total_area / units  # Average monthly rent per unit
unit_sale_value = average_unit_size * ppsf  # Sale value of each unit

project_valuation = (average_rent * units * (net_coef / 100) * 12) / (cap_rate / 100)  # Valuation of the project based on net operating income
construction_costs = total_area * cpsf  # Total construction costs for the project
soft_costs = construction_costs * ((100 - hard_soft_coef) / 100)  # Soft costs for the project
total_project_costs = land_value + construction_costs + soft_costs  # Total costs for the project

net_income = total_area * rpsf * (net_coef/100) * 12 

# Create a dictionary to store the calculated values
data_dict = {

    'total__buildbale_area': format_to_sf_area(total_area),
    'total_units': units,
    'average_unit_size': format_to_sf_area(average_unit_size),
    'average_unit_rent': format_to_dollar_price(average_rent),
    'average_unit_sale_value': format_to_dollar_price(unit_sale_value),
    'construction_cost': format_to_dollar_price(total_area * cpsf),
    'soft_costs': format_to_dollar_price(soft_costs),
    'total_cost': format_to_dollar_price(total_project_costs),
    'sale_value': format_to_dollar_price(total_area * ppsf),
    'gross_income' : format_to_dollar_price(total_area * rpsf * 12) ,
    'net_income' : format_to_dollar_price(net_income),
    'costruction_costs_per_sf': format_to_dollar_price(cpsf),
    'sale_price_per_sf': format_to_dollar_price(ppsf),
    'rent_price_per_sf': format_to_dollar_price(rpsf)
    
}


# Create a list of keys to iterate through
keys_list = [

    'total__buildbale_area',
    'total_units',
    'average_unit_size',
    'average_unit_rent',
    'average_unit_sale_value',
    'construction_cost',
    'soft_costs',
    'total_cost',
    'sale_value',
    'gross_income',
    'net_income',
    'costruction_costs_per_sf',
    'sale_price_per_sf',
    'rent_price_per_sf'
    
]

# Iterate through the keys_list and retrieve corresponding values from the data_dict
values = []
for item in keys_list:
    values.append(item + ': ' + str(data_dict[item]))

# Print the values
print(values)

dic_keys = keys_list
dic_values = []

for key in keys_list: 
    
    dic_values.append(data_dict[key])
# ---------- end python ----------
pro_forma = Panel(python.values)

cluster_2 = Cluster(massing=eli_2, typical_floor_height=typical_floor_height_2, bool=omit_last_floor_slab_2)  # -> facade_attributes_2, points_facade_attributes, walls_2, roof, floors_2, floor_plate_curves, areas, length_tree
unit_density_2 = DigitScroller(Scroller_Digits=12, Scroller_Prefix="Unit Density", Scroller_Radix=11, Scroller_Value=400)
construction_cost_per_sf_2 = DigitScroller(Scroller_Digits=12, Scroller_Prefix="Construction Cost Per SF", Scroller_Radix=11, Scroller_Value=375)
sale_price_per_sf_2 = DigitScroller(Scroller_Digits=12, Scroller_Prefix="Sale Price Per SF", Scroller_Radix=11, Scroller_Value=1075)
rent_per_sf_2 = DigitScroller(Scroller_Digits=12, Scroller_Prefix="Rent Per SF", Scroller_Radix=10, Scroller_Value=3.24)
python_2 = GhPythonScript(
    areas=cluster_2.areas,
    unit_density=unit_density_2,
    cpsf=construction_cost_per_sf_2,
    ppsf=sale_price_per_sf_2,
    rpsf=rent_per_sf_2,
    cap_rate=cap_rate,
    net_coef=net_coefficient,
    land_value=land_value,
    hard_soft_coef=hard_vs_soft_coef)  # -> values, dic_keys, dic_values; inputs areas: list; same code as python
pro_forma_2 = Panel(python_2.values)

cluster_3 = Cluster(massing=eli_3, typical_floor_height=typical_floor_height_3, bool=omit_last_floor_slab_3)  # -> facade_attributes_2, points_facade_attributes, walls_2, roof, floors_2, floor_plate_curves, areas, length_tree
unit_density_3 = DigitScroller(Scroller_Digits=12, Scroller_Prefix="Unit Density", Scroller_Radix=11, Scroller_Value=300)
construction_cost_per_sf_3 = DigitScroller(Scroller_Digits=12, Scroller_Prefix="Construction Cost Per SF", Scroller_Radix=11, Scroller_Value=175)
sale_price_per_sf_3 = DigitScroller(Scroller_Digits=12, Scroller_Prefix="Sale Price Per SF", Scroller_Radix=11, Scroller_Value=1075)
rent_per_sf_3 = DigitScroller(Scroller_Digits=12, Scroller_Prefix="Rent Per SF", Scroller_Radix=10, Scroller_Value=3.24)
python_3 = GhPythonScript(
    areas=cluster_3.areas,
    unit_density=unit_density_3,
    cpsf=construction_cost_per_sf_3,
    ppsf=sale_price_per_sf_3,
    rpsf=rent_per_sf_3,
    cap_rate=cap_rate,
    net_coef=net_coefficient,
    land_value=land_value,
    hard_soft_coef=hard_vs_soft_coef)  # -> values, dic_keys, dic_values; inputs areas: list; same code as python
pro_forma_3 = Panel(python_3.values)

brep = Brep(cluster.floors_2)
brep_2 = Brep(cluster.walls_2)
brep_3 = Brep(cluster.roof)
brep_4 = Brep(cluster_2.floors_2)
brep_5 = Brep(cluster_3.floors_2)
python_4 = GhPythonScript(string=python.dic_values)  # -> flatten(out)
# ---------- python_4: Python ----------
__author__ = "Iliya Muzychuk"
__version__ = "2023.02.03"

import rhinoscriptsyntax as rs
import Grasshopper as gh
import Rhino.Geometry as rg
import ghpythonlib.components as comps

import re

def extract_numbers(string):
    numbers = re.findall(r'\d+(?:,\d+)*(?:\.\d+)?', string)
    return [float(num.replace(',', '')) for num in numbers]


out = extract_numbers(str(string))
# ---------- end python_4 ----------
python_5 = GhPythonScript(string=python_2.dic_values)  # -> flatten(out); same code as python_4
python_6 = GhPythonScript(string=python_3.dic_values)  # -> flatten(out); same code as python_4

# ---- group: Proforma Calculations
land_value_2 = DigitScroller(Scroller_Digits=12, Scroller_Prefix="Land Value", Scroller_Radix=11, Scroller_Value=1300000)
hard_vs_soft_coef_2 = DigitScroller(Scroller_Digits=12, Scroller_Prefix="Hard vs Soft Coef", Scroller_Radix=11, Scroller_Value=75)
construction_cost_per_sf_4 = DigitScroller(Scroller_Digits=12, Scroller_Prefix="Construction Cost Per SF", Scroller_Radix=11, Scroller_Value=375)
sale_price_per_sf_4 = DigitScroller(Scroller_Digits=12, Scroller_Prefix="Sale Price Per SF", Scroller_Radix=11, Scroller_Value=1044)
cap_rate_2 = DigitScroller(Scroller_Digits=12, Scroller_Prefix="Cap Rate", Scroller_Radix=11, Scroller_Value=5)
net_coefficient_2 = DigitScroller(Scroller_Digits=12, Scroller_Prefix="Net Coefficient", Scroller_Radix=11, Scroller_Value=85)
rent_per_sf_4 = DigitScroller(Scroller_Digits=12, Scroller_Prefix="Rent Per SF", Scroller_Radix=10, Scroller_Value=4.64)

# ----
panel = Panel("""3
6
10
13""")
panel_2 = Panel("""Residential
Commerical
Parking""")
merge = Merge(Data1=graft(python_4), Data2=graft(python_5), Data3=graft(python_6))
flip = FlipMatrix(Data=merge)
writexl = WriteToExcel(
    Run=Toggle(True),
    ExcelWorksheet="1",
    ColumnNames=panel_2,
    RowNames=python.dic_keys,
    WriteOptions="None",
    ColumnnsOrRows=True,
    DataToWriteIntoColumns=merge)
swatch = ColourSwatch(SwatchColor=RGB(125, 125, 125))
swatch_2 = ColourSwatch(SwatchColor=RGB(0, 0, 0))
output_floors = Brep()

# ---- group: Output - Walls
walls = Surface()

# ----
output_roof = Brep()

# ---- group: Output - Floors As Curve
crv = Curve()

# ----
preview = CustomPreview(Material=ColourSwatch(SwatchColor=RGB(191, 191, 191)))
preview_2 = CustomPreview(Geometry=output_roof, Material=swatch)
preview_3 = CustomPreview(Geometry=output_floors, Material=swatch)
output = DataOutput(
    DataInput=walls,
    Destination="C:\Volumes\GoogleDrive-113227027081246915491\My Drive\Scripting Repository\Exchange Data\FacadeWalls_comm.ghdata",
    RelativePath="C:\Volumes\GoogleDrive-113227027081246915491\My Drive\Scripting Repository\Exchange Data\FacadeWalls_comm.ghdata|..\..\..\..\..\Volumes\GoogleDrive-113227027081246915491\My Drive\Scripting Repository\Exchange Data\FacadeWalls_comm.ghdata")
output_2 = DataOutput(
    DataInput=output_roof,
    Destination="C:\Volumes\GoogleDrive-113227027081246915491\My Drive\Scripting Repository\Exchange Data\Roof_comm.ghdata",
    RelativePath="C:\Volumes\GoogleDrive-113227027081246915491\My Drive\Scripting Repository\Exchange Data\Roof_comm.ghdata|..\..\..\..\..\Volumes\GoogleDrive-113227027081246915491\My Drive\Scripting Repository\Exchange Data\Roof_comm.ghdata")
output_3 = DataOutput(
    DataInput=output_floors,
    Destination="C:\Volumes\GoogleDrive-113227027081246915491\My Drive\Scripting Repository\Exchange Data\Floors_comm.ghdata",
    RelativePath="C:\Volumes\GoogleDrive-113227027081246915491\My Drive\Scripting Repository\Exchange Data\Floors_comm.ghdata|..\..\..\..\..\Volumes\GoogleDrive-113227027081246915491\My Drive\Scripting Repository\Exchange Data\Floors_comm.ghdata")
create_file = CreateFile(ElementsSetsOrElements=<missing>, Info=<missing>, Path=<missing>)

# ---- group: Proforma Calculations
total_parking_area = DigitScroller(Scroller_Digits=12, Scroller_Prefix="Total Parking Area", Scroller_Radix=11, Scroller_Value=1200)
construction_cost_per_sf_parking = DigitScroller(Scroller_Digits=12, Scroller_Prefix="Construction Cost Per SF Parking", Scroller_Radix=11, Scroller_Value=125)
python_7 = GhPythonScript(
    hard_soft_coef=hard_vs_soft_coef_2,
    costruction_costs_per_sf=construction_cost_per_sf_4,
    costruction_costs_per_sf_parking=construction_cost_per_sf_parking,
    sale_price_per_sf=sale_price_per_sf_4,
    rent_price_per_sf=rent_per_sf_4,
    cap_rate=cap_rate_2,
    net_coef=net_coefficient_2)  # -> values
# ---------- python_7: Python ----------
__author__ = "ilouh"
__version__ = "2023.02.21"

import rhinoscriptsyntax as rs
import Grasshopper as gh
import Rhino.Geometry as rg
import ghpythonlib.components as comps
import math



def format_to_dollar_price(value):
    if isinstance(value, (int, float)):
        formatted_value = "${:,.2f}".format(value)
    elif isinstance(value, str):
        # Remove any non-numeric characters
        value = ''.join(filter(str.isdigit, value))
        if value:
            formatted_value = "${:,.2f}".format(float(value)/100)
        else:
            formatted_value = "$0.00"
    else:
        raise TypeError("Unsupported value type. Only int, float, and str are supported.")
    
    return formatted_value

def float_to_percentage(number):
    percentage = number * 100
    formatted_percentage = "{:.2f}%".format(percentage)
    return formatted_percentage

#_______________________________________________________________________________________

# Create a dictionary to store the calculated values

data_dict = {

    'hard_vs_soft_coef': float_to_percentage(hard_soft_coef/100),
    'costruction_costs_per_sf': format_to_dollar_price(costruction_costs_per_sf),
    'costruction_costs_per_sf_parking': format_to_dollar_price(costruction_costs_per_sf_parking),
    'sale_price_per_sf': format_to_dollar_price(sale_price_per_sf),
    'rent_price_per_sf': format_to_dollar_price(rent_price_per_sf),
    'cap_rate': float_to_percentage(cap_rate/100),
    'net_vs_gross_coef': float_to_percentage(net_coef/100)
}

# Create a dataframe from the dictionary

values = []

keys_list = [

    'costruction_costs_per_sf',
    'costruction_costs_per_sf_parking',
    'sale_price_per_sf',
    'rent_price_per_sf',
    'cap_rate',
    'net_vs_gross_coef',
    'hard_vs_soft_coef'
]

for item in keys_list:
    values.append(item + ': ' + str(data_dict[item]))
# ---------- end python_7 ----------
panel_3 = Panel("""3
5""")
ins = InsertItems(List=python_7, Indices=panel_3, Wrap=True)
panel_4 = Panel(ins)

# ----
python_8 = GhPythonScript(
    areas=cluster.areas,
    total_parking_area=total_parking_area,
    length_tree=cluster.length_tree,
    cpsf=construction_cost_per_sf_4,
    cpsf_parking=construction_cost_per_sf_parking,
    ppsf=sale_price_per_sf_4,
    rpsf=rent_per_sf_4,
    cap_rate=cap_rate_2,
    net_coef=net_coefficient_2,
    land_value=land_value_2,
    hard_soft_coef=hard_vs_soft_coef_2)  # -> values, dic_keys, dic_values; inputs areas: list, length_tree: list
# ---------- python_8: Python ----------
__author__ = "ilouh"
__version__ = "2023.02.21"

import rhinoscriptsyntax as rs
import Grasshopper as gh
import Rhino.Geometry as rg
import ghpythonlib.components as comps
import math

#sum a list of numbers
def sum(numbers):
    total = 0
    for n in numbers:
        total += n
    return total


units = len(length_tree)
total_area = sum(areas)

#Functions
def format_to_dollar_price(value):
    if isinstance(value, (int, float)):
        formatted_value = "${:,.2f}".format(value)
    elif isinstance(value, str):
        # Remove any non-numeric characters
        value = ''.join(filter(str.isdigit, value))
        if value:
            formatted_value = "${:,.2f}".format(float(value)/100)
        else:
            formatted_value = "$0.00"
    else:
        raise TypeError("Unsupported value type. Only int, float, and str are supported.")
    
    return formatted_value

def float_to_percentage(number):
    percentage = number * 100
    formatted_percentage = "{:.2f}%".format(percentage)
    return formatted_percentage

def format_to_sf_area(value):
    if isinstance(value, (int, float)):
        formatted_value = "{:,.2f} SF".format(value)
    else:
        raise TypeError("Unsupported value type. Only int and float are supported.")
    
    return formatted_value

#_______________________________________________________________________________________
# Calculations
average_unit_size = total_area / units  # Average size of each unit in square feet
average_rent = float(rpsf) * total_area / units  # Average monthly rent per unit
unit_sale_value = average_unit_size * ppsf  # Sale value of each unit

project_valuation = (average_rent * units * (net_coef / 100) * 12) / (cap_rate / 100)  # Valuation of the project based on net operating income
construction_costs = total_area * cpsf  # Total construction costs for the project
soft_costs = construction_costs * ((100 - hard_soft_coef) / 100)  # Soft costs for the project
total_project_costs = land_value + construction_costs + soft_costs  # Total costs for the project

net_income = total_area * rpsf * (net_coef/100) * 12 

# Create a dictionary to store the calculated values
data_dict = {
    'total__buildbale_area': format_to_sf_area(total_area),
    'total_parking_area': format_to_sf_area(total_parking_area),
    'total_units': units,
    'average_unit_size': format_to_sf_area(average_unit_size),
    'average_unit_rent': format_to_dollar_price(average_rent),
    'average_unit_sale_value': format_to_dollar_price(unit_sale_value),
    'land_value': format_to_dollar_price(land_value),
    'construction_cost': format_to_dollar_price(total_area * cpsf + total_parking_area * cpsf_parking),
    'soft_costs': format_to_dollar_price(soft_costs),
    'total_cost': format_to_dollar_price(total_project_costs),
    'sale_value': format_to_dollar_price(total_area * ppsf),
    'project_valuation': format_to_dollar_price(project_valuation),
    'gross_profit': format_to_dollar_price(total_area * ppsf - total_project_costs),
    'gross_margin': float_to_percentage((total_area * ppsf - total_project_costs) / (total_area * ppsf)),
    'gross_income' : format_to_dollar_price(total_area * rpsf * 12) ,
    'net_income' : format_to_dollar_price(net_income)
}

# Create a list of keys to iterate through
keys_list = [
    'total__buildbale_area',
    'total_parking_area',
    'total_units',
    'average_unit_size',
    'average_unit_rent',
    'average_unit_sale_value',
    'land_value',
    'construction_cost',
    'soft_costs',
    'total_cost',
    'sale_value',
    'project_valuation',
    'gross_profit',
    'gross_margin',
    'gross_income',
    'net_income'
]

# Iterate through the keys_list and retrieve corresponding values from the data_dict
values = []
for item in keys_list:
    values.append(item + ': ' + str(data_dict[item]))

# Print the values
print(values)

dic_keys = data_dict.keys()
dic_values = data_dict.values()
# ---------- end python_8 ----------
ins_2 = InsertItems(List=python_8.values, Indices=panel, Wrap=True)

# ---- group: Proforma Calculations (continued)
panel_5 = Panel(ins_2)

# ==== cluster Cluster
massing = ClusterInput()
typical_floor_height = ClusterInput()
typical_floor_height_2 = Integer(typical_floor_height)
massing_2 = Brep(massing)

# ---- group: Calculates Building Height
bbox = BoundingBox(Content=massing_2, Plane=PlaneXY(0, 0, 0), UnionBox=True)  # -> Box, Box_2
box_corners = BoxCorners(Box=bbox.Box)  # -> CornerA, CornerB, CornerC, CornerD, CornerE, CornerF, CornerG, CornerH

# ----
Z = UnitZ(Factor=1)
contour = Contour(Shape=massing_2, Point=box_corners.CornerA, Direction=Z, Distance=typical_floor_height_2)  # -> simplify(Contours)
tstat = TreeStatistics(Tree=contour)  # -> Paths, Length, Count
trim = TrimTree(Tree=contour, Depth=1)
panel = Panel(trim)
floors_as_curves = Curve(simplify(contour))

# ---- group: Isolate Faces of Mass
debrep = DeconstructBrep(Brep=massing_2)  # -> Faces, Edges, Vertices
evalsrf = EvaluateSurface(Surface=reparameterize(debrep.Faces), Point="{0.5,0.5,0}")  # -> Point, Normal, UDirection, VDirection, Frame
distributefaces = GhPythonScript(v=evalsrf.Normal, faces=debrep.Faces)  # -> floors, facadeWalls, roof; inputs v: list, faces: list
# ---------- distributefaces: Python ----------
__author__ = "ilouh"
__version__ = "2023.01.08"

import rhinoscriptsyntax as rs
import ghpythonlib.components as comps
import Rhino.Geometry as geom

#elements = comps.DeconstructBrep(mass)
#faces = elements['faces']

#find the normal of each face


roof = []
floors = []
solidWalls = []
facadeWalls = [] 

for i in range(0,len(v)):
    
    
    values = comps.DeconstructVector(v[i])
    print(values)
    
    x_value = values['x_component']
    y_value = values['y_component']
    z_value = values['z_component']
    
    

    if z_value >= 0.4:
        
        print(i)
        roof.append(faces[i])
    
    if z_value == -1:
        
        floors.append(faces[i])
   
    if abs(z_value) != 1:
    
        facadeWalls.append(faces[i])
# ---------- end distributefaces ----------

# ----
srf = Surface(graft(distributefaces.facadeWalls))
srf_2 = Surface(flatten(distributefaces.roof))
srf_3 = Surface(distributefaces.floors)
flatten = FlattenTree(Tree=srf_3, Path="{0}")
trim_2 = TrimTree(Tree=srf, Depth=1)
area = Area(Geometry=flatten)  # -> Area, Centroid
bool = ClusterInput()
ma = MassAddition(Input=area.Area)  # -> Result, PartialResults
walls = Surface(simplify(trim_2))

# ---- group: Pass if Tree or List
python = GhPythonScript(x=floors_as_curves, tree=floors_as_curves)  # -> simplify(flatten(a)); inputs x: list, tree: tree
# ---------- python: Python ----------
__author__ = "ilouh"
__version__ = "2023.02.21"

import rhinoscriptsyntax as rs
import Grasshopper as gh
import Rhino.Geometry as rg
import ghpythonlib.components as comps
from ghpythonlib import treehelpers as th
import math

def remove_brackets(input_str):
    # Remove the brackets
    content = input_str.strip('{}')
    # Split the string by commas and convert to integers
    numbers = [int(num) for num in content.split(';')]

    return numbers
    
test_li = th.tree_to_list(tree)
test_value = len(test_li)

tree_stats = comps.TreeStatistics(tree)
tree_paths = tree_stats['paths']
tree_paths = tree_paths[0]
tree_path_structure = remove_brackets(str(tree_paths))
tree_path_structure_length = len(tree_path_structure)
print(tree_path_structure_length)


if tree_path_structure_length > 1:
    a = True
else:
    a = False
# ---------- end python ----------
trim_3 = TrimTree(Tree=floors_as_curves, Depth=1)
flatten_2 = FlattenTree(Tree=floors_as_curves, Path="{0}")

# ----
item = ListItem(List=python, Index=0, Wrap=True)

# ---- group: Pass if Tree or List (continued)
filter = StreamFilter(Gate=item, Stream0=flatten_2, Stream1=trim_3)

# ----
cls = Closed(Curve=filter)  # -> Closed, Periodic
panel_2 = Panel(cls.Closed)
cull = CullPattern(List=filter, CullPattern=cls.Closed)

# ---- group: Calculates Gross Building Area
python_2 = GhPythonScript(Floor_Plate_Curves=cull, bool=bool)  # -> keys, simplify(values), TotalBuildingArea, Floor_Plate_Curves; inputs Floor_Plate_Curves: list of Curve, floorList: list of Int32
# ---------- python_2: Python ----------
__author__ = "Iliya Muzychuk"
__version__ = "2023.02.03"

import rhinoscriptsyntax as rs
import Grasshopper as gh
import Rhino.Geometry as rg
import ghpythonlib.components as comps

FloorNames = []
FloorAreas = []

#Funcition to find the key of a dictionary by value 

def findKey(value_to_find,dic):
    for key, value in dic.items():
        if abs(value - value_to_find) < 2:
            return key
dic = {}
#Create a name and claculates the area of each floor
for i in range(0,len(floorList)):
    floor_number = 1 + i
    dic_name = 'Floor {}'.format(floor_number)
    dic[dic_name] = floorList[i]

print(dic)

if bool == True: 

    Floor_Plate_Curves.pop(-1)

else:
    
    pass

for  floor in Floor_Plate_Curves: 
    
    
    Floor_Area = comps.Area(floor)
    FloorAreas.append(round(Floor_Area['area'],2))

    
    z_value = int(Floor_Area['centroid'][2])
    print(z_value)
    Floor_Name = findKey(z_value,dic)
    
    print(Floor_Name)

    FloorNames.append(Floor_Name)

keys = FloorNames
values = FloorAreas

TotalBuildingArea = sum(values)
# ---------- end python_2 ----------

# ---- group: creates the extrusion distance
floor_thickness = Slider(0.5, range=0..1)
neg = Negative(Value=floor_thickness)
Z_2 = UnitZ(Factor=neg)
extr = Extrude(Base=python_2.Floor_Plate_Curves, Direction=Z_2)
cap = CapHoles(Brep=extr)

# ----
panel_3 = Panel(python_2.TotalBuildingArea)

extr_2 = Extrude(Base=srf_2, Direction=Z_2)
cap_2 = CapHoles(Brep=extr_2)

floors = Brep(simplify(cap))
flatten_3 = FlattenTree(Tree=python_2.values, Path="{0}")
tstat_2 = TreeStatistics(Tree=python_2.values)  # -> Length_tree, Length, Count

# ---- group: Outputs
floor_plate_curves = ClusterOutput(python_2.Floor_Plate_Curves)
floors_2 = ClusterOutput(floors)
walls_2 = ClusterOutput(walls)
roof = ClusterOutput(cap_2)

# ----
areas = ClusterOutput(flatten_3)
length_tree = ClusterOutput(tstat_2.Length_tree)
flatten_4 = FlattenTree(Tree=python_2.TotalBuildingArea, Path="{0}")
graft = GraftTree(Tree=flatten_4, IncludeEmptyLists=True, IncludeNullItems=True)

# ---- group: Calculates Wall Area Ratio
python_3 = GhPythonScript(walls=walls, totalBuildingArea=graft)  # -> keys, values, result; inputs walls: list
# ---------- python_3: Python ----------
__author__ = "Iliya Muzychuk"
__version__ = "2023.02.03"

import rhinoscriptsyntax as rs
import Grasshopper as gh
import Rhino.Geometry as rg
import ghpythonlib.components as comps

#A function to convert a float to percentage

def float_to_percentage(number):
    return '{:.2%}'.format(number)
    
wall_areas = []

for wall in walls:
    
    area = rs.Area(wall)
    wall_areas.append(area)

total_wall_area = round(sum(wall_areas),2)
wall_area_ratio = total_wall_area / totalBuildingArea

#Dictionary constructions allows future json file control 

dic = {

    'Total Facade Area' : total_wall_area,
    'Wall area/Floor area Ratio' : float_to_percentage(wall_area_ratio)

}

keys = dic.keys()
values = dic.values() 

result = []

for key, value in dic.items():
    
    string = str(key) + ": " + str(value)
    result.append(string)
# ---------- end python_3 ----------

# ----
facade_attributes = Data(python_3.result)

lng = ListLength(List=simplify(facade_attributes))
series = Series(Start=0, Step=typical_floor_height_2, Count=lng)

Z_3 = UnitZ(Factor=series)
move = Move(Motion=Z_3)  # -> Points_Facade_Attributes, Transform

points_facade_attributes = ClusterOutput(move.Points_Facade_Attributes)
facade_attributes_2 = ClusterOutput(facade_attributes)
